# Grasshopper definition sample.ghx (Grasshopper 0.9.76)

pt = ConstructPoint(XCoordinate=Slider(2, range=0..10), YCoordinate=Slider(2, range=0..10), ZCoordinate=Slider(2, range=0..10))
pt_2 = ConstructPoint(XCoordinate=Slider(2, range=0..10), YCoordinate=Slider(2, range=0..10), ZCoordinate=Slider(2, range=0..10))
ln = Line(StartPoint=pt, EndPoint=pt_2)
